# Grasshopper definition base_plates.ghx (Grasshopper 1.0.8)
# plug-ins: Human, LadybugGrasshopper

pln = Plane()  # disabled
number_slider = Slider(0.14, range=0..1)
number_slider_2 = Slider(0.3, range=0..1)
list = ValueList({"parallel_to_ground", "Perpendicular_to_grain"}, selected="Perpendicular_to_grain")
falsestart = LBFalseStartToggle(False)
falsestart_2 = LBFalseStartToggle(False)
xy = XYPlane(Origin=Point(0, 0, 0))  # disabled
falsestart_3 = LBFalseStartToggle(False)
path = FilePath(null)
py3 = Python3Script(include_stiffeners=falsestart, enabled=falsestart_2)  # -> out, members, base_plates
# ---------- py3: Python ----------
"""
Grasshopper Py3 wrapper: base_plate_geometry

GH Inputs expected:
- payload_override
- line_model_path
- plate_length
- plate_width
- plate_thickness
- bottom_face_mode
- include_hierarchies
- enabled

GH Outputs:
- out
- payload
- members
- base_plates
- preview_breps
"""

import importlib.util
import os
import sys
import traceback

ROOT = r"C:\Users\Juste\Documents\_GitHub\MAS-2526\10_llhil-t2-fabrication\design\structure_model\Base_Plates"
DEFAULT_PLATE_LENGTH = 0.8
DEFAULT_PLATE_WIDTH = 0.8
DEFAULT_PLATE_THICKNESS = 0.02

# Diagnostic: print resolved path
print("[GH Wrapper] ROOT:", ROOT)
HELPER_PATH = os.path.join(ROOT, "base_plate_geometry.py")
print("[GH Wrapper] HELPER_PATH:", HELPER_PATH)
print("[GH Wrapper] HELPER_EXISTS:", os.path.exists(HELPER_PATH))



def _load_helper():
    module_name = "base_plate_geometry"
    sys.modules.pop(module_name, None)
    spec = importlib.util.spec_from_file_location(module_name, HELPER_PATH)
    if spec is None or spec.loader is None:
        raise ImportError("Could not load {0}".format(HELPER_PATH))
    module = importlib.util.module_from_spec(spec)
    # Required for dataclasses/type resolution during module execution in GH Py3.
    sys.modules[module_name] = module
    try:
        spec.loader.exec_module(module)
    except Exception as e:
        print("[GH Wrapper] Error importing base_plate_geometry.py:", e)
        import traceback
        print(traceback.format_exc())
        raise
    return module


try:
    helper = _load_helper()

    if "enabled" in globals() and enabled is False:
        out = "Base plate geometry disabled."
        payload = {}
        members = []
        base_plates = []
        preview_breps = []
    else:
        if "payload_override" in globals() and isinstance(payload_override, dict) and payload_override:
            payload = payload_override
        else:
            kwargs = {
                "plate_length": DEFAULT_PLATE_LENGTH,
                "plate_width": DEFAULT_PLATE_WIDTH,
                "plate_thickness": DEFAULT_PLATE_THICKNESS,
                "bottom_face_mode": "Perpendicular_to_grain",
            }
            if "line_model_path" in globals() and line_model_path:
                from pathlib import Path
                kwargs["line_model_path"] = Path(str(line_model_path))
            else:
                # Fallback for GH context: use absolute path to repo's line_model data
                from pathlib import Path
                fallback_path = Path(r"C:\Users\Juste\Documents\_GitHub\MAS-2526\10_llhil-t2-fabrication\design\line_model\data\meters_shifted_lines.json")
                if fallback_path.exists():
                    kwargs["line_model_path"] = fallback_path
                else:
                    # Try alternate filenames
                    for alt in ["0806_shifted_lines.json", "shifted_lines.json"]:
                        alt_path = fallback_path.parent / alt
                        if alt_path.exists():
                            kwargs["line_model_path"] = alt_path
                            break
            if "plate_length" in globals() and plate_length is not None:
                kwargs["plate_length"] = float(plate_length)
            if "plate_width" in globals() and plate_width is not None:
                kwargs["plate_width"] = float(plate_width)
            if "plate_thickness" in globals() and plate_thickness is not None:
                kwargs["plate_thickness"] = float(plate_thickness)
            if "bottom_face_mode" in globals() and bottom_face_mode:
                kwargs["bottom_face_mode"] = str(bottom_face_mode)
            if "include_hierarchies" in globals() and include_hierarchies:
                kwargs["include_hierarchies"] = include_hierarchies

            payload = helper.build_geometry_payload(**kwargs)
        members = payload.get("members", [])
        base_plates = payload.get("base_plates", [])
        print("[GH Wrapper] Extracted members: {0}".format(len(members)))
        print("[GH Wrapper] Extracted base_plates: {0}".format(len(base_plates)))
        
        preview_breps = []
        if hasattr(helper, "BasePlateRecord") and base_plates:
            try:
                bp_records = [helper.BasePlateRecord(**bp) for bp in base_plates]
                preview_breps = helper.build_preview_breps(bp_records)
                print("[GH Wrapper] Built {0} preview breps".format(len(preview_breps)))
            except Exception as bp_err:
                print("[GH Wrapper] Error building preview breps: {0}".format(bp_err))
                import traceback
                print(traceback.format_exc())
        
        unit_hint = ""
        if members and base_plates:
            try:
                mw = float((members[0] or {}).get("width") or 0.0)
                pl = float((base_plates[0] or {}).get("length") or 0.0)
                if mw > 0.0 and pl / mw > 20.0:
                    unit_hint = " | WARNING: plate/member scale looks too large; check mm vs m"
            except Exception:
                pass
        out = "Loaded {0} members and built {1} base plates{2}".format(len(members), len(base_plates), unit_hint)
        print("[GH Wrapper] " + out)

except Exception:
    out = traceback.format_exc()
    payload = {}
    members = []
    base_plates = []
    preview_breps = []
    print("[GH Wrapper] Exception caught:")
    print(out)
# ---------- end py3 ----------
bp_geometry = Python3Script(plate_thickness=Slider(0.015, range=0..1), bottom_face_mode=list, enabled=falsestart_3)  # -> out, payload, preview_breps; inputs line_model_path: String; same code as py3
dimaligned = AlignedDimension()  # -> AlignedDimension, Plane, PointA, PointB, Offset, Style
preview = CustomPreview(Geometry=py3.members, Material=ColourSwatch(SwatchColor=RGB(0, 0, 255)))
panel = Panel(py3.out)
preview_2 = CustomPreview(Geometry=bp_geometry.preview_breps, Material=ColourSwatch(SwatchColor=RGB(0, 0, 255)))
panel_2 = Panel(bp_geometry.out)
falsestart_4 = LBFalseStartToggle(False)
bp_calculations = Python3Script(
    geometry_payload=bp_geometry.payload,
    min_allowable_clearance=Slider(80, range=0..100),
    base_plate_min_thickness=Slider(0.15, range=0..1),
    bottom_face_mode=list,
    enabled=falsestart_4)  # -> out, report_text, package, pass_fail_summary, utilization_values, payload, synced_geometry_payload
# ---------- bp_calculations: Python ----------
"""
Grasshopper Py3 wrapper: base_plate_calculations

GH Inputs expected:
- geometry_payload
- bottom_face_mode
- min_allowable_clearance
- shift_step
- max_shift
- base_plate_min_thickness
- base_plate_max_thickness
- sync_plate_dimensions_from_engineering
- sync_iterations
- engineering_overrides
- enabled

GH Outputs:
- out
- payload
- report_text
- combined_report
- pass_fail_summary
- utilization_values
- synced_geometry_payload
- a
- b
- c
- d
- e
- f
- g
- h
- i
- j
- k
- l
- m
- n
"""

import importlib.util
import os
import sys
import traceback

ROOT = r"C:\Users\Juste\Documents\_GitHub\MAS-2526\10_llhil-t2-fabrication\design\structure_model\Base_Plates"
HELPER_PATH = os.path.join(ROOT, "base_plate_calculations.py")


def _load_helper():
    module_name = "base_plate_calculations"
    sys.modules.pop(module_name, None)
    spec = importlib.util.spec_from_file_location(module_name, HELPER_PATH)
    if spec is None or spec.loader is None:
        raise ImportError("Could not load {0}".format(HELPER_PATH))
    module = importlib.util.module_from_spec(spec)
    spec.loader.exec_module(module)
    return module


try:
    helper = _load_helper()

    if "enabled" in globals() and enabled is False:
        out = "Base plate calculations disabled."
        payload = {}
    else:
        if "geometry_payload" not in globals() or not geometry_payload:
            raise ValueError("geometry_payload input is required")

        kwargs = {
            "geometry_payload": geometry_payload,
            "bottom_face_mode": str(bottom_face_mode) if "bottom_face_mode" in globals() and bottom_face_mode else "Perpendicular_to_grain",
            "min_allowable_clearance": float(min_allowable_clearance) if "min_allowable_clearance" in globals() and min_allowable_clearance is not None else 80.0,
            "shift_step": float(shift_step) if "shift_step" in globals() and shift_step is not None else 10.0,
            "max_shift": float(max_shift) if "max_shift" in globals() and max_shift is not None else 400.0,
            "base_plate_min_thickness": float(base_plate_min_thickness) if "base_plate_min_thickness" in globals() and base_plate_min_thickness is not None else 10.0,
            "base_plate_max_thickness": float(base_plate_max_thickness) if "base_plate_max_thickness" in globals() and base_plate_max_thickness is not None else 60.0,
            "sync_plate_dimensions_from_engineering": bool(sync_plate_dimensions_from_engineering) if "sync_plate_dimensions_from_engineering" in globals() else True,
            "sync_iterations": int(sync_iterations) if "sync_iterations" in globals() and sync_iterations is not None else 1,
        }
        if "engineering_overrides" in globals() and engineering_overrides:
            kwargs["engineering_overrides"] = engineering_overrides

        payload = helper.run_validation(**kwargs)
        out = "Validated {0} members".format(len(payload.get("member_results", [])))

    report_text = payload.get("report_text", "") if payload else ""
    combined_report = payload.get("combined_report", "") if payload else ""
    pass_fail_summary = payload.get("pass_fail_summary", {}) if payload else {}
    utilization_values = payload.get("utilization_values", {}) if payload else {}
    synced_geometry_payload = payload.get("synced_geometry_payload", {}) if payload else {}

    a = payload.get("a") if payload else None
    b = payload.get("b") if payload else None
    c = payload.get("c") if payload else None
    d = payload.get("d") if payload else None
    e = payload.get("e") if payload else None
    f = payload.get("f") if payload else None
    g = payload.get("g") if payload else None
    h = payload.get("h") if payload else None
    i = payload.get("i") if payload else None
    j = payload.get("j") if payload else None
    k = payload.get("k") if payload else None
    l = payload.get("l") if payload else None
    m = payload.get("m") if payload else None
    n = payload.get("n") if payload else None

except Exception:
    out = traceback.format_exc()
    payload = {}
    report_text = ""
    combined_report = ""
    pass_fail_summary = {}
    utilization_values = {}
    synced_geometry_payload = {}
    a = b = c = d = e = f = g = h = i = j = k = l = m = n = None
# ---------- end bp_calculations ----------
list_2 = ValueList({"parallel_to_ground", "Perpendicular_to_grain"}, selected="parallel_to_ground")
panel_3 = Panel(bp_calculations.report_text)
panel_4 = Panel(bp_calculations.pass_fail_summary)
panel_5 = Panel(bp_calculations.utilization_values)
panel_6 = Panel(bp_calculations.package)
bp_ct_json = Python3Script(
    geometry_payload=bp_calculations.synced_geometry_payload,
    calc_payload=bp_calculations.payload,
    bottom_face_mode=list_2,
    enabled=Button())  # -> out, package, inspection_breps, json_path; inputs bottom_face_mode: String
# ---------- bp_ct_json: Python ----------
import importlib.util
import os
import sys
import traceback
from pathlib import Path

ROOT = r"C:\Users\Juste\Documents\_GitHub\MAS-2526\10_llhil-t2-fabrication\design\structure_model\Base_Plates"
HELPER_PATH = os.path.join(ROOT, "ct_anchor_milling.py")


def _load_helper():
    module_name = "ct_anchor_milling"
    sys.modules.pop(module_name, None)
    spec = importlib.util.spec_from_file_location(module_name, HELPER_PATH)
    if spec is None or spec.loader is None:
        raise ImportError("Could not load {0}".format(HELPER_PATH))
    module = importlib.util.module_from_spec(spec)
    spec.loader.exec_module(module)
    return module


try:
    helper = _load_helper()

    if "enabled" in globals() and enabled is False:
        out = "CT export disabled."
        package = {}
        records = []
        timber_model_schema = {}
        inspection_breps = []
        json_path = None
    else:
        if "geometry_payload" not in globals() or not geometry_payload:
            raise ValueError("geometry_payload input is required")
        if "calc_payload" not in globals() or not calc_payload:
            raise ValueError("calc_payload input is required")

        effective_geometry_payload = geometry_payload
        if isinstance(calc_payload, dict):
            maybe_synced = calc_payload.get("synced_geometry_payload")
            if isinstance(maybe_synced, dict) and maybe_synced:
                effective_geometry_payload = maybe_synced

        target_path = Path(str(out_json_path)) if "out_json_path" in globals() and out_json_path else (Path(ROOT) / "ct_anchor_milling_export.json")

        package = helper.export_ct_json(
            geometry_payload=effective_geometry_payload,
            calc_payload=calc_payload,
            out_json_path=target_path,
            process_only_passed=bool(process_only_passed) if "process_only_passed" in globals() else False,
        )
        records = package.get("records", [])
        timber_model_schema = package.get("timber_model_schema", {})
        inspection_breps = helper.build_inspection_breps(records)
        json_path = str(target_path)
        out = "Exported {0} CT records".format(len(records))

except Exception:
    out = traceback.format_exc()
    package = {}
    records = []
    timber_model_schema = {}
    inspection_breps = []
    json_path = None
# ---------- end bp_ct_json ----------
panel_7 = Panel(bp_ct_json.json_path)
preview_3 = CustomPreview(Geometry=bp_calculations.synced_geometry_payload, Material=ColourSwatch(SwatchColor=RGB(152, 152, 152)))
previewmat = CustomPreviewMaterials(Geometry=bp_ct_json.inspection_breps, DiffuseColor=RGB(255, 255, 255))
preview_4 = CustomPreview(Geometry=bp_ct_json.inspection_breps, Material=ColourSwatch(SwatchColor=RGB(0, 0, 0)))
