# Grasshopper definition 0513_timber_model.ghx (Grasshopper 1.0.8)

py3 = Python3Script()  # -> out, line_model
# ---------- py3: Python ----------
from compas.data import json_load

import os, sys, importlib

gh_dir = os.path.dirname(ghenv.Component.OnPingDocument().FilePath)
gh_par = os.path.dirname(gh_dir)
file_path = os.path.join(gh_par, "line_model","data", "260512_v3_shifted_lines.json")

print(file_path)

line_model = json_load(file_path)
# ---------- end py3 ----------

# ----
# Construct Timber Models
py3_2 = Python3Script(graph=py3.line_model)  # -> out, models
# ---------- py3_2: Python ----------
import os, sys, importlib

gh_dir = os.path.dirname(ghenv.Component.OnPingDocument().FilePath)
if gh_dir not in sys.path:
    sys.path.insert(0, gh_dir)

import timber_model
importlib.reload(timber_model)
from timber_model import graph_to_timber_models

#
models = graph_to_timber_models(graph, align_shoe=False)

print (list(m.attributes['group'] for m in models))


models.sort(key=lambda m: m.attributes['group'])

print (list(m.attributes['group'] for m in models))
# ---------- end py3_2 ----------

# ----
# Apply Joints
list = ValueList({"Zero": 0, "One": 1, "Two": 2, "Three": 2² - 1}, selected=["One", "Two"])
item = ListItem(List=py3_2.models, Index=list, Wrap=True)
py3_3 = Python3Script(models=item)  # -> out, models; inputs models: list
# ---------- py3_3: Python ----------
import os, sys, importlib

gh_dir = os.path.dirname(ghenv.Component.OnPingDocument().FilePath)
if gh_dir not in sys.path:
    sys.path.insert(0, gh_dir)

import timber_model
importlib.reload(timber_model)
from timber_model import apply_joints



#
for model in models:
    model = apply_joints(model)
# ---------- end py3_3 ----------

# ----
# Preview
toggle = BooleanToggle(True)
python_3_script = Python3Script(models=py3_3.models, process=toggle)  # -> out, geos, colors, cut_planes; inputs models: list, process: Boolean
# ---------- python_3_script: Python ----------
import rhinoscriptsyntax as rs
import scriptcontext as sc
import Rhino.Display as rd
import System.Drawing as sd

from compas.scene import Scene
from compas.geometry import Line, Point
from copy import deepcopy

models = deepcopy(models)

COLORS = {
    "primary":      sd.Color.FromArgb(255, 220,  50,  50),
    "main_primary": sd.Color.FromArgb(255, 150,  80, 220),
    "secondary":    sd.Color.FromArgb(255,  50, 150, 220),
    "tertiary":     sd.Color.FromArgb(255,  80, 200, 100),
    "shoe":         sd.Color.FromArgb(255,  20, 150, 100),
    "plate":        sd.Color.FromArgb(255,  100, 100, 100)
}


geos = []
colors = []
cut_planes = []

for model in models:
    if process:
        model.process_joinery()
        
    for plate in model.plates:
        geos.append(plate.geometry)
        colors.append(COLORS['plate'])

    for beam in model.beams:
        hie = beam.attributes.get('hierarchy')

        geos.append(beam.geometry)
        colors.append(COLORS[hie])

    cut_planes.append(model.attributes['cut_plane'])
# ---------- end python_3_script ----------
compas_draw = COMPASDraw(cg=python_3_script.geos)  # -> rg
#   port cg: The COMPAS geometry or datastructure to be drawn.
#   port rg: The Rhino geometry object.
# ---------- compas_draw: Python ----------
# r: compas>=2.14.1
"""
Draws COMPAS geometry in Grasshopper.
"""

from typing import Any

import Grasshopper

from compas.scene import SceneObject


class CompasToRhinoGeometry(Grasshopper.Kernel.GH_ScriptInstance):
    def RunScript(self, cg):
        if not cg:
            return None

        return SceneObject(item=cg).draw()
# ---------- end compas_draw ----------
compas_draw_2 = COMPASDraw(cg=python_3_script.cut_planes)  # -> rg; same code as compas_draw
preview = CustomPreview(Geometry=compas_draw, Material=python_3_script.colors)
